# Grasshopper definition MusicToArchitecture_MVP.gh (Grasshopper 1.0.8)

# ---- group: A · CONTRACT INPUT
# MUSIC → ARCHITECTURE
# Original GH definition
# JSON → schema gate → massing / frame → validation
# Each Python component has one bounded responsibility.
refresh = BooleanToggle(True)
_01_contract_watcher = _01ContractWatcher(x="runtime\inbox\building_model_v2.json", y=refresh)  # -> out, a
# ---------- _01_contract_watcher: Python ----------
import os
path_value = str(x) if x is not None else ''
refresh_value = bool(y)
gh_path = ghenv.Component.OnPingDocument().FilePath
base_dir = os.path.dirname(gh_path) if gh_path else os.getcwd()
resolved = os.path.abspath(os.path.join(base_dir, path_value)) if not os.path.isabs(path_value) else path_value
try:
    with open(resolved, 'r', encoding='utf-8-sig') as f:
        json_text = f.read()
    status = 'WATCH OK | ' + os.path.basename(resolved)
except Exception as exc:
    json_text = ''
    status = 'WATCH FAIL | ' + str(exc)
print(status)
a = json_text
# ---------- end _01_contract_watcher ----------
panel = Panel(_01_contract_watcher.out)

# ---- group: B · SCHEMA GATE
_02_schema_gate_parser = _02SchemaGateParser(x=_01_contract_watcher.a, y="2.0")  # -> out, a
# ---------- _02_schema_gate_parser: Python ----------
import json
json_text = str(x) if x is not None else ''
supported = str(y) if y is not None else '2.0'
model = None
try:
    parsed = json.loads(json_text)
    version = str(parsed.get('schema_version', ''))
    if version != supported:
        raise ValueError('schema_version ' + version + ' != ' + supported)
    if not isinstance(parsed.get('elements'), list):
        raise ValueError('elements must be a list')
    model = parsed
    status = 'SCHEMA OK | v' + version + ' | elements=' + str(len(parsed['elements']))
except Exception as exc:
    status = 'SCHEMA FAIL | ' + str(exc)
print(status)
a = model
# ---------- end _02_schema_gate_parser ----------
panel_2 = Panel(_02_schema_gate_parser.out)

# ---- group: C · BUILDING SYSTEMS
model_scale = Slider(1, range=0.5..2)
_03_massing_generator = _03MassingGenerator(x=_02_schema_gate_parser.a, y=model_scale)  # -> out, a
# ---------- _03_massing_generator: Python ----------
import Rhino.Geometry as rg
model = x if isinstance(x, dict) else None
scale = float(y) if y is not None else 1.0
breps = []
try:
    if model is None:
        raise ValueError('no accepted model')
    for element in model.get('elements', []):
        if element.get('kind') != 'massing':
            continue
        p = element.get('position', {})
        s = element.get('dimensions', {})
        box = rg.Box(rg.Plane.WorldXY,
            rg.Interval((float(p.get('x',0))-float(s.get('x',0))/2.0)*scale, (float(p.get('x',0))+float(s.get('x',0))/2.0)*scale),
            rg.Interval((float(p.get('y',0))-float(s.get('y',0))/2.0)*scale, (float(p.get('y',0))+float(s.get('y',0))/2.0)*scale),
            rg.Interval((float(p.get('z',0))-float(s.get('z',0))/2.0)*scale, (float(p.get('z',0))+float(s.get('z',0))/2.0)*scale))
        breps.append(box.ToBrep())
    status = 'MASSING OK | breps=' + str(len(breps))
except Exception as exc:
    breps = []
    status = 'MASSING FAIL | ' + str(exc)
print(status)
from Grasshopper import DataTree
from Grasshopper.Kernel.Data import GH_Path
tree = DataTree[object]()
for item in breps:
    tree.Add(item, GH_Path(0))
a = tree
# ---------- end _03_massing_generator ----------
_04_frame_generator = _04FrameGenerator(x=_02_schema_gate_parser.a, y=model_scale)  # -> out, a
# ---------- _04_frame_generator: Python ----------
import Rhino.Geometry as rg
model = x if isinstance(x, dict) else None
scale = float(y) if y is not None else 1.0
members = []
try:
    if model is None:
        raise ValueError('no accepted model')
    for element in model.get('elements', []):
        if element.get('kind') not in ('column','beam'):
            continue
        p = element.get('position', {})
        s = element.get('dimensions', {})
        box = rg.Box(rg.Plane.WorldXY,
            rg.Interval((float(p.get('x',0))-float(s.get('x',0))/2.0)*scale, (float(p.get('x',0))+float(s.get('x',0))/2.0)*scale),
            rg.Interval((float(p.get('y',0))-float(s.get('y',0))/2.0)*scale, (float(p.get('y',0))+float(s.get('y',0))/2.0)*scale),
            rg.Interval((float(p.get('z',0))-float(s.get('z',0))/2.0)*scale, (float(p.get('z',0))+float(s.get('z',0))/2.0)*scale))
        members.append(box.ToBrep())
    status = 'FRAME OK | members=' + str(len(members))
except Exception as exc:
    members = []
    status = 'FRAME FAIL | ' + str(exc)
print(status)
from Grasshopper import DataTree
from Grasshopper.Kernel.Data import GH_Path
tree = DataTree[object]()
for item in members:
    tree.Add(item, GH_Path(0))
a = tree
# ---------- end _04_frame_generator ----------
panel_3 = Panel(_03_massing_generator.out)
panel_4 = Panel(_04_frame_generator.out)

# ---- group: D · VALIDATION / ACCEPTED STATE
require_provenance = BooleanToggle(True)
_05_validation_accepted_state = _05ValidationAcceptedState(x=_02_schema_gate_parser.a, y=require_provenance)  # -> out, a
# ---------- _05_validation_accepted_state: Python ----------
model = x if isinstance(x, dict) else None
strict = bool(y)
report = {}
try:
    if model is None:
        raise ValueError('no accepted model')
    checks = model.get('validation', [])
    failed = [c for c in checks if str(c.get('status', '')).lower() != 'pass']
    elements = model.get('elements', [])
    missing = [e.get('id','?') for e in elements if not e.get('score_bindings')]
    accepted = len(failed) == 0 and (len(missing) == 0 or not strict)
    report = {'accepted': accepted, 'failed_checks': failed, 'missing_score_bindings': missing, 'element_count': len(elements)}
    status = ('VALIDATION PASS' if accepted else 'VALIDATION FAIL') + ' | elements=' + str(len(elements)) + ' | failed=' + str(len(failed)) + ' | unbound=' + str(len(missing))
except Exception as exc:
    status = 'VALIDATION FAIL | ' + str(exc)
print(status)
a = report
# ---------- end _05_validation_accepted_state ----------
panel_5 = Panel(_05_validation_accepted_state.out)
